# Grasshopper definition 2D_shape.gh (Grasshopper 1.0.8)

xy_plane = XYPlane(Origin=Point(0, 0, 0))
rectangle = Rectangle(Plane=xy_plane, XSize=Slider(17, range=0..100), YSize=Slider(10, range=0..100), Radius=0)  # -> Rectangle, Length
ellipse = Ellipse(Plane=xy_plane, Radius1=Slider(24, range=0..100), Radius2=Slider(40, range=0..100))  # -> Ellipse, Focus1, Focus2
move = Move(Geometry=rectangle.Rectangle, Motion=Vector(0, 0, 10))  # -> Geometry, Transform
